# Grasshopper definition 191006_Massing_Opt_V4.gh (Grasshopper 1.0.7)
# plug-ins: Spectacles.GrasshopperExporter, LunchBox, Colibri

# ----
# Side 2
# Parameter 1: Length
number_slider = Slider(-5, range=-20..100)
Z = UnitZ(Factor=number_slider)
select_first_side = Line(Line((-20.13931993, -57.3728834, 59.0511248), (-49.60062993, -16.9849734, 59.0511248)))
move = Move(Geometry=select_first_side, Motion=Z)  # -> Geometry, Transform
end = EndPoints(Curve=move.Geometry)  # -> Start, End
parameter_1_length_2 = Slider(0.15, range=0.05..0.15)
ln = Line(StartPoint=end.End, EndPoint=end.Start)
eval = EvaluateLength(Curve=ln, Length=parameter_1_length_2, Normalized=True)  # -> Point, Tangent, Parameter
eval_2 = EvaluateLength(Curve=move.Geometry, Length=parameter_1_length_2, Normalized=True)  # -> Point, Tangent, Parameter

# ---- group: Side 2
# Parameter 1: Length
number_slider_2 = Slider(-13, range=-20..100)
# Side 1
select_first_side_2 = Line(Line((53.23884007, 19.5039766, 59.0511248), (21.76746007, 59.4728166, 59.0511248)))
Z_2 = UnitZ(Factor=number_slider_2)
move_2 = Move(Geometry=select_first_side_2, Motion=Z_2)  # -> Geometry, Transform
end_2 = EndPoints(Curve=move_2.Geometry)  # -> Start, End
parameter_1_length_1 = Slider(0.15, range=0.05..0.15)
ln_2 = Line(StartPoint=end_2.End, EndPoint=end_2.Start)
eval_3 = EvaluateLength(Curve=ln_2, Length=parameter_1_length_1, Normalized=True)  # -> Point, Tangent, Parameter
eval_4 = EvaluateLength(Curve=move_2.Geometry, Length=parameter_1_length_1, Normalized=True)  # -> Point, Tangent, Parameter

# ----
swatch = ColourSwatch(SwatchColor=RGB(255, 26, 255))
number_slider_3 = Slider(0.5, range=0..1)
spectacles_meshlambertmaterial = Spectacles_MeshLambertMaterial(Color=swatch, AmbientColor=swatch, EmissiveColor=RGB(0, 0, 0), Object_Opacity=number_slider_3, SmoothEdges=True)
material = CreateMaterial(Diffuse=swatch, Specular=RGB(255, 255, 255), Emission=RGB(0, 0, 0), Transparency=number_slider_3, Shine=0)
spectacles_mesh = Spectacles_Mesh(MeshMaterial=spectacles_meshlambertmaterial)
preview = CustomPreview(Material=material)
spectacles_scenecompiler = Spectacles_SceneCompiler(Write=Toggle(True), Elements=flatten(spectacles_mesh))
spectacles_viewer = LaunchSpectaclesViewer(URL="http://tt-acm.github.io/Spectacles.WebViewer/", LaunchBoolean=False)

path = FilePath("G:\Polimi\Courses\Semester 3\Combined Project\Analysis\Climate Analysis\CHN_Hong.Kong.SAR.450070_CityUHK.epw")
number_slider_4 = Slider(0.026, range=0..0.1)
number_slider_5 = Slider(77, range=0..100)
importepw = Ladybug_ImportEpw(epwFile=path)  # -> readMe, latitude, location, dryBulbTemperature, dewPointTemperature, relativeHumidity, windSpeed, windDirection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; plug-in component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
combination_of_parameters_datas = Panel("10<a<30 and 15<b<20 and 20<c<95")
panel = Panel(eval_3.Point)

# ----
# Parameter 2: Width
parameter_2_width2 = Slider(12, range=10..12)
line = Line(Line((-20.13931993, -57.3728834, 59.0511248), (-12.33107995, -49.19234343, 59.0511248)))
eval_5 = EvaluateLength(Curve=line, Length=Slider(1, range=0..1), Normalized=True)  # -> Point, unitize(Tangent), Parameter
amp = Amplitude(Vector=eval_5.Tangent, Amplitude=parameter_2_width2)
move_3 = Move(Geometry=eval_2.Point, Motion=amp)  # -> Geometry, Transform
rec_3pt = Rectangle3Pt(PointA=eval_2.Point, PointB=eval.Point, PointC=move_3.Geometry)  # -> Rectangle, Length

# ----
# Parameter 2: Width
number_slider_6 = Slider(1, range=0..1)
parameter_2_width1 = Slider(12, range=10..12)
line_2 = Line(Line((53.23884007, 19.5039766, 59.0511248), (43.22530549, 9.012992683, 59.0511248)))
eval_6 = EvaluateLength(Curve=line_2, Length=number_slider_6, Normalized=True)  # -> Point, unitize(Tangent), Parameter
amp_2 = Amplitude(Vector=eval_6.Tangent, Amplitude=parameter_2_width1)
move_4 = Move(Geometry=eval_4.Point, Motion=amp_2)  # -> Geometry, Transform
rec_3pt_2 = Rectangle3Pt(PointA=eval_4.Point, PointB=eval_3.Point, PointC=move_4.Geometry)  # -> Rectangle, Length

number_slider_7 = Slider(0, range=0..10)

revsrf = ReverseSurfaceDirection(Surface=rec_3pt.Rectangle, ReverseOption=Slider(1, range=0..1))

ladybug = Ladybug_Ladybug()  # -> Vviiiiiiiiiizzz; plug-in component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

# ----
# Creation of floors
no_of_floors = Slider(26, range=12..26)
level_height = Slider(3.5, range=3..4)
pt = Point(end_2.Start)
area = Area(Geometry=rec_3pt_2.Rectangle)  # -> Area, Centroid
pdecon = Deconstruct(Point=pt)  # -> XComponent, YComponent, ZComponent
boundary = BoundarySurfaces(Edges=rec_3pt_2.Rectangle)
series = Series(Start=0, Step=level_height, Count=no_of_floors)
multiplication = Multiplication(A=no_of_floors, B=area.Area)
Z_3 = UnitZ(Factor=1)
floors_heights = LineSDL(Start=pt, Direction=Z_3, Length=series)
move_5 = Move(Geometry=boundary, Motion=floors_heights)  # -> Geometry, Transform

# ----
# Total SA connection between buildings
expression = Expression(x=multiplication, Expression="18000-(x)")
panel_2 = Panel(expression)

# ----
# Creation of floors 2
starting_point_can_change_if_the_height = Point(end.Start)  # "starting point (can change if the height changes"
boundary_2 = BoundarySurfaces(Edges=rec_3pt.Rectangle)
area_2 = Area(Geometry=rec_3pt.Rectangle)  # -> Area, Centroid
pdecon_2 = Deconstruct(Point=starting_point_can_change_if_the_height)  # -> XComponent, YComponent, ZComponent
division = Division(A=panel_2, B=area_2.Area)
number_of_floors = Integer(division)
series_2 = Series(Start=0, Step=level_height, Count=number_of_floors)
floors_heights_2 = LineSDL(Start=starting_point_can_change_if_the_height, Direction=Z_3, Length=series_2)
move_6 = Move(Geometry=boundary_2, Motion=floors_heights_2)  # -> Geometry, Transform

# ----
# !! Key to run !!
toggle = BooleanToggle(True)

# ----
# Volume Creation
item = ListItem(List=series, Index="-1", Wrap=True)
boxrec = BoxRectangle(Rectangle=rec_3pt_2.Rectangle, Height=item)
brep = Brep(boxrec)
volume = Volume(Geometry=brep)  # -> Volume, Centroid

# ----
# Volume Creation
panel_3 = Panel("-1")
item_2 = ListItem(List=series_2, Index=panel_3, Wrap=True)
boxrec_2 = BoxRectangle(Rectangle=revsrf, Height=item_2)
brep_2 = Brep(boxrec_2)
volume_2 = Volume(Geometry=brep_2)  # -> Volume, Centroid

debrep = DeconstructBrep(Brep=brep_2)  # -> Faces, Edges, Vertices
item_3 = ListItem(List=debrep.Faces, Index=Slider(4, range=0..10), Wrap=True)
area_3 = Area(Geometry=item_3)  # -> Area, Centroid
merge = Merge(Data1=brep, Data2=brep_2)
building = Brep(merge)

# ----
# Space/Vol ratio
debrep_2 = DeconstructBrep(Brep=brep)  # -> Faces, Edges, Vertices
area_4 = Area(Geometry=debrep_2.Faces)  # -> Area, Centroid
ma = MassAddition(Input=area_4.Area)  # -> Result, PartialResults
space_volume_ratio_b1 = Division(A=ma.Result, B=volume.Volume)

# ----
# Space/Vol ratio
debrep_3 = DeconstructBrep(Brep=brep_2)  # -> Faces, Edges, Vertices
area_5 = Area(Geometry=debrep_3.Faces)  # -> Area, Centroid
ma_2 = MassAddition(Input=area_5.Area)  # -> Result, PartialResults
space_volume_ratio_b2 = Division(A=ma_2.Result, B=volume.Volume)

panel_4 = Panel("""3
3
3
3
7""")

# ----
# Visualisation
brep_3 = Brep([brep_2, brep])
wires = BrepWireframe(Brep=brep_3, Density=-1)
mesh = Mesh(brep_3)
spectacles_line = Spectacles_Line(Line=wires)
mcol = MeshColours(Mesh=mesh, Colours=ColourSwatch(SwatchColor=RGB(0, 202, 105)))
spectacles_meshcoloredvertices = Spectacles_MeshColoredVertices(Mesh=mcol)
_3dobjects = SpectaclesColibri_3DObjects(Elements=flatten([spectacles_line, spectacles_meshcoloredvertices]))

# ----
# Input Parameters
domain = Domain(Domain(0, 1))
selection = IterationSelection(Divisions=panel_4)
iterator = ColibriIterator(
    Parameter_1_Length_1=parameter_1_length_1,
    Parameter_1_Length_2=parameter_1_length_2,
    Parameter_2_Width1=parameter_2_width1,
    Parameter_2_Width2=parameter_2_width2,
    No_of_Floors=no_of_floors,
    Selection=selection,
    RemoteFly=False,
    ignoreAllWarningMsg=False)  # -> Parameter_1_Length_1, Parameter_1_Length_2, Parameter_2_Width1, Parameter_2_Width2, No_of_Floors, Genome

# ----
# Adjusting 2D camera View
pt_2 = Point(Point(0, -412.8206684, 362.5105762))
pt_3 = Point(Point(-1.138747693, -2.372285978, 50.47598872))
vec2pt = Vector2Pt(PointA=pt_3, PointB=pt_2, Unitize=False)  # -> Vector, Length
spectacles_views = Spectacles_Views(EyePosition=pt_3, Target=pt_2)
vdisex = VectorDisplayEx(Point=pt_2, Vector=vec2pt.Vector, Colour=RGB(0, 0, 0), Width=2)

panel_5 = Panel("G:\Polimi\Courses\Semester 3\Combined Project\Analysis\Massing\191005_Grasshopper_trials")
panel_6 = Panel("C:\Users\Gabriele\Desktop\,\SBT\Analysis")

# ----
# Winter Sun  hours Calculation
number_slider_8 = Slider(12, range=0..12)
analysisperiod = Ladybug_AnalysisPeriod(fromMonth=number_slider_8, toMonth=Slider(2, range=0..12))  # -> readMe, analysisPeriod; plug-in component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
sunpath = Ladybug_SunPath(
    location=importepw.location,
    hour=12,
    day=21,
    month=12,
    timeStep=1,
    analysisPeriod=analysisperiod.analysisPeriod,
    centerPt=area_3.Centroid,
    projection=number_slider_7,
    dailyOrAnnualSunPath=True)  # -> readMe, sunVectors, sunAltitudes, sunAzimuths, port, sunSpheresMesh, sunPathCrvs, compassCrvs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; plug-in component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

# ----
# Summer Season sunhours calculation
number_slider_9 = Slider(5, range=0..10)
analysisperiod_2 = Ladybug_AnalysisPeriod(fromMonth=number_slider_9, toMonth=Slider(9, range=0..12))  # -> readMe, analysisPeriod; plug-in component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
sunpath_2 = Ladybug_SunPath(
    location=importepw.location,
    hour=12,
    day=21,
    month=12,
    timeStep=1,
    analysisPeriod=analysisperiod_2.analysisPeriod,
    centerPt=area_3.Centroid,
    projection=number_slider_7,
    dailyOrAnnualSunPath=True)  # -> readMe, sunVectors, sunAltitudes, sunAzimuths, port, sunSpheresMesh, sunPathCrvs, compassCrvs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; plug-in component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
environment = Brep([<brep referenced from the Rhino model> x147])
toggle_2 = BooleanToggle(True)

# ----
# Total Radiation
toggle_3 = BooleanToggle(True)
gencumulativeskymtx = Ladybug_GenCumulativeSkyMtx(epwFile=path, skyDensity=0, useOldRes=True, runIt=toggle_3)  # -> readMe, cumulativeSkyMtx; plug-in component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
selectskymtx = Ladybug_selectSkyMtx(
    cumulativeSkyMtx=gencumulativeskymtx.cumulativeSkyMtx,
    analysisPeriod=analysisperiod_2.analysisPeriod,
    removeDiffuse=False,
    removeDirect=False)  # -> readMe, selectedSkyMtx; plug-in component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
number_slider_10 = Slider(8, range=0..10)
number_slider_11 = Slider(0.1, range=0..0.1)
radiationanalysis = Ladybug_RadiationAnalysis(
    geometry=flatten(building),
    context=flatten(environment),
    gridSize=number_slider_10,
    disFromBase=number_slider_11,
    selectedSkyMtx=flatten(selectskymtx.selectedSkyMtx),
    parallel=Toggle(True),
    runIt=Toggle(True))  # -> readMe, contextMesh, analysisMesh, testPts, testVec, port, radiationResult, radiationMesh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; plug-in component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

panel_7 = Panel(radiationanalysis.totalRadiation)

sunlighthoursanalysis = Ladybug_SunlightHoursAnalysis(
    geometry=flatten(building),
    context=flatten(environment),
    gridSize=number_slider_10,
    disFromBase=number_slider_11,
    sunVectors=flatten(sunpath_2.sunVectors),
    timeStep=1,
    parallel=toggle_2,
    runIt=toggle)  # -> readMe, contextMesh, analysisMesh, testPts, testVec, port, sunlightHoursResult, sunlightHoursMesh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; plug-in component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

sunlighthoursanalysis_2 = Ladybug_SunlightHoursAnalysis(
    geometry=flatten(building),
    context=flatten(environment),
    gridSize=number_slider_10,
    disFromBase=number_slider_11,
    sunVectors=flatten(sunpath.sunVectors),
    timeStep=1,
    parallel=toggle_2,
    runIt=toggle)  # -> readMe, contextMesh, analysisMesh, testPts, testVec, port, sunlightHoursResult, sunlightHoursMesh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; plug-in component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

geo = Geometry(radiationanalysis.radiationLegend)
mesh_2 = Mesh(radiationanalysis.radiationMesh)
mesh_3 = Mesh(sunlighthoursanalysis.sunlightHoursLegend)

Y = UnitY(Factor=Slider(560, range=0..1000))
move_7 = Move(Geometry=mesh_3, Motion=Y)  # -> Geometry, Transform

# ----
# Potential Parameters
summer_tot_sunlight_hours = Integer(flatten(sunlighthoursanalysis.totalSunlightHours))
winter_tot_sunlight_hours = Integer(flatten(sunlighthoursanalysis_2.totalSunlightHours))
total_radiation = Integer(flatten(radiationanalysis.totalRadiation))
space_volume_ratio_b2_2 = Data(space_volume_ratio_b2)
space_volume_ratio_b1_2 = Data(space_volume_ratio_b1)

# ----
# Output Parameters
# !! Key !!
toggle_4 = BooleanToggle(False)
parameters = ColibriParameters(
    Summer_tot_sunlight_hours=flatten(summer_tot_sunlight_hours),
    Winter_tot_sunlight_hours=flatten(winter_tot_sunlight_hours),
    Total_Radiation=flatten(total_radiation),
    Space_Volume_ratio_B1=flatten(space_volume_ratio_b1_2),
    Space_Volume_ratio_B2=flatten(space_volume_ratio_b2_2))
img_setting = ImageSetting(ImageSaveAsName="defaultName", RhinoViewNames=spectacles_views, Width=600, Height=600)
panel_8 = Panel("G:\Polimi\Courses\Semester 3\Combined Project\Analysis\Massing\191004_Grasshopper_trials")
aggregator = ColibriAggregator(
    Folder=panel_5,
    IterationGenomeID=iterator.Genome,
    IterationPhenomeResults=parameters,
    ImgSetting=img_setting,
    _3DObjects=flatten(_3dobjects),
    Write=toggle_4,
    recordingMode=3)
panel_9 = Panel(aggregator)
